vi "Record.gvi"   [LabVIEW Communications System Design Suite 2.0.1]
panel controls:
  "number of samples per segment": i64 = 10000000
  "IQ rate": f64 = 40000000
  "carrier frequency": f64 = 2422000000
  "gain (dB)": f64 = 30
  "active antenna": string = "RX2"
  "Stop": bool
  "niUSRP Device": "niUSRPClass"
  "Mode": string = "00 WiFi Background"
  "Drone Status": string = "00: On & Connected"
  "Band": string
panel indicators:
  "Errors": error
  "Segment Number": string
diagram:
  Divide(x=$"number of samples per segment", y=2) -> w1
  Obtain Queue(element data type=i16[] []) -> (error out=w2, queue out=w3)
  call "niUSRP Open Rx Session.gvi"(niUSRP Device=$"niUSRP Device") -> (error out=w4, session handle out=w5)
  call "niUSRP Configure Signal.gvi"(session handle=w5, IQ rate=$"IQ rate", carrier frequency=$"carrier frequency", gain=$"gain (dB)", error in (no error)=w4, active antenna=$"active antenna") -> (session handle out=w6, Error Out=w7)
  # Shift local ocillator away
  # from center frequency
  Add($"IQ rate", $"carrier frequency") -> w8
  Property Node(instance in=w6, "Host Data Type"="I16", "LO Frequency"=w8, error in=w7) -> (error out=w9, instance out=w10)
  Merge Errors(w9, w2) -> (error out=w11)
  call "niUSRP Initiate.gvi"(session handle=w10, error in (no error)=w11) -> (session handle out=w12, Error Out=w13)
  while {
    call "niUSRP Fetch Rx Data (I16).gvi"(session handle=w12, number of samples=w1, error in (no error)=w13) -> (session handle out=w14, data=w15, Error Out=w16)
    Enqueue Element(element=w15, error in=w16, queue=w3, timeout in ms=1000) -> (error out=w17, queue out=w18)
    Logical And(w17, $Stop) -> w19
    stop if w19
  }
  call "niUSRP Abort.gvi"(Handle in=w14, error in (no error)=w17) -> (Handle out=w20, Error Out=w21)
  call "niUSRP Close Session.gvi"(handle in=w20, error in=w21) -> (error out=w22)
  String Subset(length (rest)=2, string=$Mode) -> w23
  String Subset(length (rest)=2, string=$"Drone Status") -> w24
  Is Equal(x="00", y=w23) -> w25
  case (w25) {
    frame False, Default {
      Concatenate Strings(w23, w24) -> w26
    }
    frame True {
      w26 = "0000"
    }
  }
  String Subset(length (rest)=1, string=$Band) -> w27
  while (iteration -> i1) {
    Dequeue Element(error in=w13, queue=w3, timeout in ms=1000) -> (element=w28, error out=w29, queue out=w30, timed out?=w31)
    Array To Spreadsheet String(array=w28, delimiter=",", format string="%f") -> (spreadsheet string=w32)
    Number To Decimal String(number=i1) -> (decimal integer string=w33)
    Concatenate Strings("D:\\Users\\loaner\\Desktop\\Al-Sa'd\\Data\\", w26, w27, "_", w33, ".csv") -> w34
    String To Path(string=w34) -> (path=w35)
    Open Or Create Or Replace File(access (0:read/write)="write-only", file path (use dialog)=w35, operation (0:open)="replace or create") -> (refnum out=w36)  # Open/Create/Replace File
    Write To Text File(error in=w29, file (use dialog)=w36, text=w32) -> (error out=w37, refnum out=w38)
    Get Queue Status(error in=w37, queue=w30) -> (error out=w39, queue out=w40)
    Is Equal(x=100, y=i1) -> w41
    Logical Or(w39, w31, w41) -> w42
    $"Segment Number" <- w33
    stop if w42
  }
  Release Queue(error in=w39, queue=w40) -> (error out=w43)
  Close File(error in=w43, refnum=w38) -> (error out=w44)
  Merge Errors(w22, w44) -> (error out=w45)
  $Errors <- w45
  call "Display Error.gvi"(error in=w45)
